# Dynamo graph beugelScript.dyn (Dynamo 3.2.1.5366)

# group: Select all ducts
# Select all objects of type "Duct"
select_duct_category = Categories("OST_DuctCurves")
get_all_ducts = ElementsOfCategory(Category=select_duct_category)
select_duct_fittings_category = Categories("OST_DuctFitting")
get_all_duct_fittings = ElementsOfCategory(Category=select_duct_fittings_category)

# group: Cleanup
family_types = FamilyTypes("VE_Bracket_MEPcontent_CAIROX_OBMC:125")
all_elements_of_family_type = ElementsOfFamilyType(Family_Type=family_types)
family_types_2 = FamilyTypes("VE_Bracket_MEPcontent_CAIROX_OBMC:160")
all_elements_of_family_type_2 = ElementsOfFamilyType(Family_Type=family_types_2)
family_types_3 = FamilyTypes("VE_Bracket_MEPcontent_CAIROX_OBMC:200")
all_elements_of_family_type_3 = ElementsOfFamilyType(Family_Type=family_types_3)
family_types_4 = FamilyTypes("VE_Bracket_MEPcontent_CAIROX_OBMC:250")
all_elements_of_family_type_4 = ElementsOfFamilyType(Family_Type=family_types_4)
family_types_5 = FamilyTypes("VE_Bracket_MEPcontent_CAIROX_OBMC:Default")
all_elements_of_family_type_5 = ElementsOfFamilyType(Family_Type=family_types_5)
family_types_6 = FamilyTypes("JUV_57.0_DUA_UN_Beugel rechthoekig kanaal:400")
all_elements_of_family_type_6 = ElementsOfFamilyType(Family_Type=family_types_6)
list_create = List.Create(item0=all_elements_of_family_type, item1=all_elements_of_family_type_2, item2=all_elements_of_family_type_3, item3=all_elements_of_family_type_4, item4=all_elements_of_family_type_5, item5=all_elements_of_family_type_6)
flatten = List.Flatten(list=list_create)
delete = Element.Delete(element=flatten)

# group: Calculate Bracket and Canal positions
file_path = Filename(".\juvah.py")
readText = FileSystem.ReadText(file=file_path)
code_block = CodeBlock(elements=get_all_duct_fittings, wait=delete) { [elements, wait][0]; }
python_script_from_string = PythonStringNode(script=readText, IN[0]=get_all_ducts, IN[1]=code_block)  # CPython3
code_block_2 = CodeBlock { 0; 1; }

# group: Brackets
# Round ducts <= 450mm diameter
getItemAtIndex = List.GetItemAtIndex(list=python_script_from_string, index=code_block_2.out0)
code_block_3 = CodeBlock { 0; 1; 2; Vector.ZAxis; }
get_family_name_and_type = List.GetItemAtIndex(list=getItemAtIndex@L4, index=code_block_3.out0)
get_family_name = List.GetItemAtIndex(list=get_family_name_and_type@L2, index=code_block_3.out0)
get_family_type = List.GetItemAtIndex(list=get_family_name_and_type@L2, index=code_block_3.out1)
byFamilyNameAndTypeName = FamilyType.ByFamilyNameAndTypeName(familyName=get_family_name, typeName=get_family_type)
get_orientation_and_points = List.GetItemAtIndex(list=getItemAtIndex@L4, index=code_block_3.out1)
get_points = List.GetItemAtIndex(list=get_orientation_and_points@L3, index=code_block_3.out0)
byPoint = FamilyInstance.ByPoint(familyType=byFamilyNameAndTypeName, point=get_points)
get_orientation = List.GetItemAtIndex(list=get_orientation_and_points@L3, index=code_block_3.out1)
setRotation = FamilyInstance.SetRotation(familyInstance=byPoint, degree=get_orientation)

# group: Canals
# Rectangular or round ducts > 450mm
family_types_7 = FamilyTypes("JUV_57.0_DUA_UN_Beugel rechthoekig kanaal:400")
getItemAtIndex_2 = List.GetItemAtIndex(list=python_script_from_string, index=code_block_2.out1)
code_block_4 = CodeBlock { 0; 1; 2; }
get_center_point = List.GetItemAtIndex(list=getItemAtIndex_2@L3, index=code_block_4.out0)
byPoint_2 = FamilyInstance.ByPoint(familyType=family_types_7, point=get_center_point)
get_orientation_2 = List.GetItemAtIndex(list=getItemAtIndex_2@L3, index=code_block_4.out2)
setRotation_2 = FamilyInstance.SetRotation(familyInstance=byPoint_2, degree=get_orientation_2)
code_block_5 = CodeBlock { "kanaal_breedte"; }
width = List.GetItemAtIndex(list=getItemAtIndex_2@L3, index=code_block_4.out1)
setParameterByName = Element.SetParameterByName(element=setRotation_2, parameterName=code_block_5, value=width)
